# Grasshopper definition  mobility sentiment mapping.gh (Grasshopper 1.0.8)
# plug-ins: Human, Heron

# Reading textfiles (with Grasshopper)
cluster = Cluster()
path = FilePath("D:\1group D\tearm1\venice_sentiment_coordinates.csv")
file = ReadFile(File=path, PerLineParse=True)
panel = Panel(file)
cull_i = CullIndex(List=file, Indices="0", Wrap=True)
tab = Panel(",")
split = TextSplit(Text=cull_i, Separators=tab)
panel_2 = Panel(split)
item = ListItem(List=split, Index="3", Wrap=True)  # -> Item, Item1, Item2, Item3, Item4, Item5
panel_3 = Panel(item.Item1)
panel_4 = Panel(item.Item2)
flatten_tree = FlattenTree(Tree=item.Item1, Path="{0}")
flatten_tree_2 = FlattenTree(Tree=item.Item, Path="{0}")
decimal_degrees_to_xy = DecimalDegreesToXY(Latitude=flatten_tree_2, Longitude=flatten_tree)  # -> XyPoint, Transform
multiplication = Multiplication(B=Slider(100, range=0..10000))
multiplication_2 = Multiplication(B=Slider(100, range=0..10000))
deconstruct = Deconstruct(Point=decimal_degrees_to_xy.XyPoint)  # -> XComponent, YComponent, ZComponent
pt = ConstructPoint(XCoordinate=multiplication_2, YCoordinate=multiplication, ZCoordinate=0)
construct_domain = ConstructDomain(DomainStart=Slider(0, range=0..100), DomainEnd=Slider(1000000, range=0..10000000))
panel_5 = Panel(pt)
remap_numbers = RemapNumbers(Value=item.Item2, Source=Domain(0, 1), Target=construct_domain)  # -> flatten(Mapped), Clipped
pt_2 = ConstructPoint(XCoordinate=deconstruct.XComponent, YCoordinate=deconstruct.YComponent, ZCoordinate=0)
pt_3 = ConstructPoint(XCoordinate=deconstruct.XComponent, YCoordinate=deconstruct.YComponent, ZCoordinate=remap_numbers.Mapped)
panel_6 = Panel(pt_3)
line = Line(StartPoint=pt_3, EndPoint=pt_2)

# ---- group: Input
geo = Geometry([<point referenced from the Rhino model> x2779])
y = Panel("30")
x = Panel("50")

# ---- group: Inclusion
sqgrid = Square(Plane=PlaneXY(0, 0, 0), Size=1, ExtentX=x, ExtentY=y)  # -> flatten(Cells), Points
area = Area(Geometry=sqgrid.Cells)  # -> Area, Centroid
merge = Merge(Data1=geo, Data2=area.Centroid)
pt_4 = Point(merge)
incurves = PointInCurves(Point=pt_4, Curves=sqgrid.Cells)  # -> Relationship, Index, Point

# ----
panel_7 = Panel(merge)

# ---- group: Check all cells
multiplication_3 = Multiplication(A=x, B=y)
series = Series(Start=0, Step=1, Count=multiplication_3)  # -> simplify(graft(Series))
equals = Equality(FirstNumber=incurves.Index, SecondNumber=series)  # -> Equality, Inequality
cull = CullPattern(List=pt_4, CullPattern=equals.Equality)
panel_8 = Panel(cull)

# ----
# SPATIAL BINNING IN GRASSHOPPER
# How do you read the result?
# 
# The first line isn0 | 21
# and that means that Point 0 is in
# curve 21
# 
# Same is true for
# 1 | 21
# 
# And the third line is 2 | 12
# and that means that point 2
# is in curve 12.
# Add contrast by "streching" the numbers
panel_9 = Panel(pt_4)
panel_10 = Panel(incurves.Index)
tstat = TreeStatistics(Tree=cull)  # -> Paths, Length, Count

# ---- group: Check one cell
equals_2 = Equality(FirstNumber=incurves.Index, SecondNumber="12")  # -> Equality, Inequality
cull_2 = CullPattern(List=pt_4, CullPattern=equals_2.Equality)
panel_11 = Panel(cull_2)

# ---- group: Surface Grid
bnd = Bounds(Numbers=flatten(tstat.Length))
dom = ConstructDomain(DomainStart="0", DomainEnd="16")
remap = RemapNumbers(Value=tstat.Length, Source=bnd, Target=dom)  # -> Mapped, Clipped
Z = UnitZ(Factor=remap.Mapped)
move = Move(Geometry=area.Centroid, Motion=Z)  # -> Geometry, Transform
srfgrid = SurfaceFromPoints(Points=move.Geometry, UCount=x, Interpolate=False)

# ---- group: Graphics & Baking
contour = Contour(Shape=srfgrid, Point=Point(0, 0, 0), Direction=Vector(0, 0, 1), Distance=Slider(0.117, range=0..1))
eval = EvaluateCurve(Curve=contour, Parameter=0)  # -> Point, Tangent, Angle
pdecon = Deconstruct(Point=eval.Point)  # -> XComponent, YComponent, ZComponent
bnd_2 = Bounds(Numbers=flatten(pdecon.ZComponent))
dedomain = DeconstructDomain(Domain=bnd_2)  # -> Start, End
gradient = Gradient(
    LowerLimit=dedomain.Start,
    UpperLimit=dedomain.End,
    Parameter=flatten(pdecon.ZComponent),
    stops=[0: RGB(234, 38, 0), 0.177: RGB(234, 126, 0), 0.332: RGB(254, 244, 84), 0.871: RGB(173, 203, 249), 1: RGB(75, 107, 169)])
preview = CustomPreview(Geometry=flatten(contour), Material=gradient)
createatts = CreateAttributes(LayerName="Contours", Color=gradient, enableFullPath=False)
bake = BakeGeometry(Bake=Button(), Geometry=flatten(contour), Attributes=createatts, DeleteOldBakes=False, PreserveTrees=False)

# ==== cluster Cluster
