# Grasshopper definition workshop data visualization.gh (Grasshopper 1.0.8)
# plug-ins: Human, Heron, eleFront5

# ----
# Field values of OSM are here:
# https://wiki.openstreetmap.org/wiki/Map_features
# you can test example values here:
# https://www.openstreetmap.org/node/6429327326
# 
# The format is
# [Key],[Value]
filterfiields = Panel("natural")
path = FilePath("D:\1group D\tearm2\field.trip\data\GH\map (2).osm")
# IMPORT AND FILTER OSM
geo = Geometry(<curve referenced from the Rhino model>)
panel = Panel("addr:postcode,SE1 7ND")
panel_2 = Panel("amenity,cafe")
filterfieldvalue = Panel("natural,tree")
importosm = ImportOSM(Boundary=geo, OSMDataLocation=path, Clipped=True)  # -> Extents, Fields, Values, FeatureGeometry, Buildings

filterfieldvalue_2 = Panel("[Key],[Value]")

path_2 = FilePath("D:\1group D\tearm2\2.19\路线3_同一地点取平均_按时间排序.csv")
file = ReadFile(File=path_2, PerLineParse=True)
panel_3 = Panel(file)
tab = Panel(",")
cull_i = CullIndex(List=file, Indices="0", Wrap=True)
split = TextSplit(Text=cull_i, Separators=tab)
item = ListItem(List=split, Index="0", Wrap=True)  # -> Item, Item1, flatten(Item2), flatten(Item3), flatten(Item4), Item5, Item6, flatten(Item7)

panel_4 = Panel(item.Item7)
surface = Surface([<surface referenced from the Rhino model> x3])  # disabled

brep = Brep(<brep referenced from the Rhino model>)  # disabled
mesh_brep = MeshBrep(
    Brep=brep,
    Settings={GridMaxCount=0, GridMinCount=16, JaggedSeams=False, MaxEdgeLength=0, MinEdgeLength=0.0001, MinTolerance=0, Refine=True, RefineAngle=0, RelativeTolerance=0.65, SimplePlanes=True, Tolerance=0})  # disabled
number_slider = Slider(1, range=0..1)  # disabled
number_slider_2 = Slider(0, range=0..100)  # disabled
deconstruct_mesh = DeconstructMesh(Mesh=mesh_brep)  # -> Vertices, Faces, Colours, Normals; disabled
deconstruct = Deconstruct(Point=deconstruct_mesh.Vertices)  # -> XComponent, YComponent, ZComponent; disabled
construct_domain = ConstructDomain(DomainStart=number_slider_2, DomainEnd=number_slider)  # disabled
unit_z = UnitZ(Factor=deconstruct.ZComponent)  # disabled
bounds = Bounds(Numbers=unit_z)  # disabled
remap_numbers = RemapNumbers(Value=unit_z, Source=bounds, Target=construct_domain)  # -> Mapped, Clipped; disabled
gradient = Gradient(
    LowerLimit=0,
    UpperLimit=1,
    Parameter=remap_numbers.Mapped,
    stops=[0: RGB(103, 0, 120), 0: RGB(210, 0, 118), 0: RGB(236, 27, 60), 0: RGB(39, 72, 161), 1: RGB(1, 192, 229), 1: RGB(220, 237, 32), 1: RGB(79, 186, 8), 1: RGB(243, 57, 0), 1: RGB(247, 159, 20), 1: RGB(18, 178, 90)])  # disabled
mesh_colours = MeshColours(Mesh=brep, Colours=gradient)  # disabled
custom_preview = CustomPreview(Geometry=deconstruct_mesh.Vertices, Material=gradient)  # disabled

number_slider_3 = Slider(300, range=0..10000)  # disabled
surface_2 = Surface([<surface referenced from the Rhino model> x3])  # disabled
number_slider_4 = Slider(300, range=0..10000)  # disabled
surface_3 = Surface([<surface referenced from the Rhino model> x3])  # disabled
number_slider_5 = Slider(300, range=0..10000)  # disabled

# ---- group: Graphics & Baking
contour = Contour(Shape=surface_3, Point=Point(0, 0, 0), Direction=Vector(0, 0, 1), Distance=number_slider_3)  # disabled
eval = EvaluateCurve(Curve=contour, Parameter=0)  # -> Point, Tangent, Angle; disabled
pdecon = Deconstruct(Point=eval.Point)  # -> XComponent, YComponent, ZComponent; disabled
bnd = Bounds(Numbers=flatten(pdecon.ZComponent))  # disabled
dedomain = DeconstructDomain(Domain=bnd)  # -> Start, End; disabled
gradient_2 = Gradient(
    LowerLimit=dedomain.Start,
    UpperLimit=dedomain.End,
    Parameter=flatten(pdecon.ZComponent),
    stops=[0: RGB(255, 128, 0), 0: RGB(227, 132, 118), 0: RGB(234, 126, 0), 0: RGB(22, 68, 216), 0: RGB(173, 203, 249), 0.00708: RGB(228, 3, 56), 0.152: RGB(255, 128, 0), 0.654: RGB(255, 255, 0), 0.993: RGB(255, 255, 192), 1: RGB(128, 255, 255)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])  # disabled
panel_5 = Panel("Contours")  # disabled
preview = CustomPreview(Geometry=flatten(contour), Material=gradient_2)  # disabled
button = Button()  # disabled
createatts = CreateAttributes(LayerName=panel_5, Color=gradient_2, enableFullPath=False)  # disabled
bake = BakeGeometry(Bake=button, Geometry=flatten(contour), Attributes=createatts, DeleteOldBakes=False, PreserveTrees=False)  # disabled

contour_2 = Contour(Shape=surface_2, Point=Point(0, 0, 0), Direction=Vector(0, 0, 1), Distance=number_slider_4)  # disabled
eval_2 = EvaluateCurve(Curve=contour_2, Parameter=0)  # -> Point, Tangent, Angle; disabled
pdecon_2 = Deconstruct(Point=eval_2.Point)  # -> XComponent, YComponent, ZComponent; disabled
bnd_2 = Bounds(Numbers=flatten(pdecon_2.ZComponent))  # disabled
dedomain_2 = DeconstructDomain(Domain=bnd_2)  # -> Start, End; disabled
gradient_3 = Gradient(
    LowerLimit=dedomain_2.Start,
    UpperLimit=dedomain_2.End,
    Parameter=flatten(pdecon_2.ZComponent),
    stops=[0: RGB(227, 132, 118), 0: RGB(234, 126, 0), 0: RGB(22, 68, 216), 0: RGB(173, 203, 249), 0.00826: RGB(0, 0, 128), 0.153: RGB(0, 0, 192), 0.888: RGB(0, 255, 255), 1: RGB(192, 255, 255), 1: RGB(128, 255, 255), 1: RGB(0, 0, 192), 1: RGB(0, 0, 255), 1: RGB(75, 107, 169)])  # disabled
panel_6 = Panel("Contours")  # disabled
preview_2 = CustomPreview(Geometry=flatten(contour_2), Material=gradient_3)  # disabled
button_2 = Button()  # disabled
createatts_2 = CreateAttributes(LayerName=panel_6, Color=gradient_3, enableFullPath=False)  # disabled
bake_2 = BakeGeometry(Bake=button_2, Geometry=flatten(contour_2), Attributes=createatts_2, DeleteOldBakes=False, PreserveTrees=False)  # disabled

contour_3 = Contour(Shape=surface, Point=Point(0, 0, 0), Direction=Vector(0, 0, 1), Distance=number_slider_5)  # disabled
eval_3 = EvaluateCurve(Curve=contour_3, Parameter=0)  # -> Point, Tangent, Angle; disabled
pdecon_3 = Deconstruct(Point=eval_3.Point)  # -> XComponent, YComponent, ZComponent; disabled
bnd_3 = Bounds(Numbers=flatten(pdecon_3.ZComponent))  # disabled
dedomain_3 = DeconstructDomain(Domain=bnd_3)  # -> Start, End; disabled
gradient_4 = Gradient(
    LowerLimit=dedomain_3.Start,
    UpperLimit=dedomain_3.End,
    Parameter=flatten(pdecon_3.ZComponent),
    stops=[0: RGB(255, 128, 0), 0: RGB(227, 132, 118), 0: RGB(234, 126, 0), 0: RGB(22, 68, 216), 0: RGB(173, 203, 249), 0.00708: RGB(128, 0, 128), 0.0497: RGB(158, 20, 227), 0.769: RGB(255, 0, 255), 0.995: RGB(255, 128, 255), 1: RGB(128, 255, 255)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])  # disabled
panel_7 = Panel("Contours")  # disabled
preview_3 = CustomPreview(Geometry=flatten(contour_3), Material=gradient_4)  # disabled
button_3 = Button()  # disabled
createatts_3 = CreateAttributes(LayerName=panel_7, Color=gradient_4, enableFullPath=False)  # disabled
bake_3 = BakeGeometry(Bake=button_3, Geometry=flatten(contour_3), Attributes=createatts_3, DeleteOldBakes=False, PreserveTrees=False)  # disabled

# ----
number_slider_6 = Slider(979121, range=0..1000000)  # disabled
curve = Curve(<curve referenced from the Rhino model>)  # disabled
divide_curve = DivideCurve(Curve=curve, Count=number_slider_6, Kinks=False)  # -> Points, Tangents, Parameters; disabled
number_slider_7 = Slider(1, range=0..1)  # disabled
number_slider_8 = Slider(0, range=0..100)  # disabled
deconstruct_2 = Deconstruct(Point=divide_curve.Points)  # -> XComponent, YComponent, ZComponent; disabled
panel_8 = Panel(divide_curve.Points)  # disabled
construct_domain_2 = ConstructDomain(DomainStart=number_slider_8, DomainEnd=number_slider_7)  # disabled
bounds_2 = Bounds(Numbers=deconstruct_2.ZComponent)  # disabled
remap_numbers_2 = RemapNumbers(Value=deconstruct_2.ZComponent, Source=bounds_2, Target=construct_domain_2)  # -> Mapped, Clipped; disabled
panel_9 = Panel(remap_numbers_2.Mapped)  # disabled
gradient_5 = Gradient(
    LowerLimit=0,
    UpperLimit=1,
    Parameter=remap_numbers_2.Mapped,
    stops=[0: RGB(103, 0, 120), 0: RGB(210, 0, 118), 0: RGB(236, 27, 60), 0: RGB(39, 72, 161), 1: RGB(1, 192, 229), 1: RGB(220, 237, 32), 1: RGB(79, 186, 8), 1: RGB(243, 57, 0), 1: RGB(247, 159, 20), 1: RGB(18, 178, 90)])  # disabled
# Reading textfiles (with Grasshopper)
# SET ANCHOR POINT
# CONVERT COORDINATES TO XY VALUES
# Bake with attributes (optional)
custom_preview_2 = CustomPreview(Geometry=divide_curve.Points, Material=gradient_5)  # disabled

path_3 = FilePath("D:\1group D\tearm2\2.19\路线3_同一地点取平均_按时间排序.csv")  # disabled
file_2 = ReadFile(File=path_3, PerLineParse=True)  # disabled
panel_10 = Panel(file_2)  # disabled
panel_11 = Panel("0")  # disabled
tab_2 = Panel(",")  # disabled
cull_i_2 = CullIndex(List=file_2, Indices=panel_11, Wrap=True)  # disabled
panel_12 = Panel("0")  # disabled
split_2 = TextSplit(Text=cull_i_2, Separators=tab_2)  # disabled
panel_13 = Panel(split_2)  # disabled
item_2 = ListItem(List=split_2, Index=panel_12, Wrap=True)  # -> Item, Item1, flatten(Item2), flatten(Item3), flatten(Item4), Item5, Item6, flatten(Item7); disabled

item_3 = ListItem(List=split, Index="5", Wrap=True)
tstat = TreeStatistics(Tree=item_3)  # -> Paths, Length, Count
dup = DuplicateData(Data="GSR", Number=tstat.Length, Order=True)  # -> simplify(Data)
ef_att = EleFrontAttributes(Keys=dup, Values=item_3, Layer="Points", maintainBakeName=False)  # -> flatten(Attributes), Keys, Values, Name, Layer, ColourSource, DisplayColour, MaterialSource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

flatten = FlattenTree(Tree=item.Item1, Path="{0}")
flatten_2 = FlattenTree(Tree=item.Item, Path="{0}")

# ----
# Reading textfiles (with Grasshopper)
# SET ANCHOR POINT
# CONVERT COORDINATES TO XY VALUES
# Bake with attributes (optional)
panel_14 = Panel(item_3)
panel_15 = Panel(cull_i)
panel_16 = Panel(dup)
flatten_tree = FlattenTree(Tree=item.Item1, Path="{0}")
flatten_tree_2 = FlattenTree(Tree=item.Item, Path="{0}")
panel_17 = Panel(item.Item)
number_slider_9 = Slider(435, range=0..1000)
panel_18 = Panel(item.Item2)
decimal_degrees_to_xy = DecimalDegreesToXY(Latitude=flatten_tree_2, Longitude=flatten_tree)  # -> XyPoint, Transform
pt = ConstructPoint(XCoordinate=item.Item1, YCoordinate=item.Item, ZCoordinate=0)
multiplication = Multiplication(A=item.Item3, B=Slider(200, range=0..1000))
multiplication_2 = Multiplication(A=item.Item4, B=Slider(2270, range=0..10000))
panel_20 = Panel(multiplication)
deconstruct_3 = Deconstruct(Point=decimal_degrees_to_xy.XyPoint)  # -> XComponent, YComponent, ZComponent
addition = Addition(A=multiplication, B=Slider(150000, range=0..1000000))
multiplication_3 = Multiplication(A=item.Item2, B=Slider(1220, range=0..10000))
addition_2 = Addition(A=multiplication_2, B=Slider(300000, range=0..1000000))
multiplication_4 = Multiplication(A=item.Item7, B=Slider(10, range=0..100000))
panel_21 = Panel(multiplication_3)
panel_22 = Panel(pt)
panel_23 = Panel(decimal_degrees_to_xy.XyPoint)
panel_24 = Panel(item.Item1)
panel_25 = Panel(multiplication_4)
pt_2 = ConstructPoint(XCoordinate=deconstruct_3.XComponent, YCoordinate=deconstruct_3.YComponent, ZCoordinate=multiplication_3)
pt_3 = ConstructPoint(XCoordinate=deconstruct_3.XComponent, YCoordinate=deconstruct_3.YComponent, ZCoordinate=addition_2)
pt_4 = ConstructPoint(XCoordinate=deconstruct_3.XComponent, YCoordinate=deconstruct_3.YComponent, ZCoordinate=addition)
polyline = PolyLine(Vertices=pt_3, Closed=False)
ln = Line(StartPoint=decimal_degrees_to_xy.XyPoint, EndPoint=pt_3)
ln_2 = Line(StartPoint=decimal_degrees_to_xy.XyPoint, EndPoint=pt_2)
ln_3 = Line(StartPoint=decimal_degrees_to_xy.XyPoint, EndPoint=pt_4)
panel_26 = Panel(pt_4)
polyline_2 = PolyLine(Vertices=pt_2, Closed=False)
polyline_3 = PolyLine(Vertices=pt_4, Closed=False)
panel_28 = Panel(pt_2)

geo_2 = Geometry(decimal_degrees_to_xy.XyPoint)

bake_4 = BakeObjects(Geometry=geo_2, Attributes=ef_att.Attributes, Bake=False, createGroups=False)  # -> Message, Ghosts

addition_3 = Addition(A=multiplication_4, B=Slider(450000, range=0..1000000))

pt_5 = ConstructPoint(XCoordinate=deconstruct_3.XComponent, YCoordinate=deconstruct_3.YComponent, ZCoordinate=addition_3)
ln_4 = Line(StartPoint=decimal_degrees_to_xy.XyPoint, EndPoint=pt_5)

panel_29 = Panel("5")  # disabled
item_4 = ListItem(List=split_2, Index=panel_29, Wrap=True)  # disabled
panel_30 = Panel("GSR")  # disabled
tstat_2 = TreeStatistics(Tree=item_4)  # -> Paths, Length, Count; disabled
dup_2 = DuplicateData(Data=panel_30, Number=tstat_2.Length, Order=True)  # -> simplify(Data); disabled
panel_31 = Panel("Points")  # disabled
ef_att_2 = EleFrontAttributes(Keys=dup_2, Values=item_4, Layer=panel_31, maintainBakeName=False)  # -> flatten(Attributes), Keys, Values, Name, Layer, ColourSource, DisplayColour, MaterialSource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; disabled

# ----
# Reading textfiles (with Grasshopper)
# SET ANCHOR POINT
# CONVERT COORDINATES TO XY VALUES
# Bake with attributes (optional)
panel_32 = Panel(item_4)  # disabled
panel_33 = Panel(cull_i_2)  # disabled
panel_34 = Panel(dup_2)  # disabled
flatten_tree_3 = FlattenTree(Tree=item_2.Item1, Path="{0}")  # disabled
flatten_tree_4 = FlattenTree(Tree=item_2.Item, Path="{0}")  # disabled
panel_35 = Panel(item_2.Item)  # disabled
number_slider_10 = Slider(435, range=0..1000)  # disabled
number_slider_11 = Slider(200, range=0..1000)  # disabled
number_slider_12 = Slider(2270, range=0..10000)  # disabled
number_slider_13 = Slider(150000, range=0..1000000)  # disabled
panel_36 = Panel(item_2.Item2)  # disabled
decimal_degrees_to_xy_2 = DecimalDegreesToXY(Latitude=flatten_tree_4, Longitude=flatten_tree_3)  # -> XyPoint, Transform; disabled
pt_6 = ConstructPoint(XCoordinate=item_2.Item1, YCoordinate=item_2.Item, ZCoordinate=0)  # disabled
number_slider_14 = Slider(1220, range=0..10000)  # disabled
number_slider_15 = Slider(300000, range=0..1000000)  # disabled
multiplication_5 = Multiplication(A=item_2.Item3, B=number_slider_11)  # disabled
number_slider_16 = Slider(10, range=0..100000)  # disabled
multiplication_6 = Multiplication(A=item_2.Item4, B=number_slider_12)  # disabled
panel_38 = Panel(multiplication_5)  # disabled
deconstruct_4 = Deconstruct(Point=decimal_degrees_to_xy_2.XyPoint)  # -> XComponent, YComponent, ZComponent; disabled
addition_4 = Addition(A=multiplication_5, B=number_slider_13)  # disabled
multiplication_7 = Multiplication(A=item_2.Item2, B=number_slider_14)  # disabled
addition_5 = Addition(A=multiplication_6, B=number_slider_15)  # disabled
multiplication_8 = Multiplication(A=item_2.Item7, B=number_slider_16)  # disabled
panel_39 = Panel(multiplication_7)  # disabled
panel_40 = Panel(pt_6)  # disabled
panel_41 = Panel(decimal_degrees_to_xy_2.XyPoint)  # disabled
panel_42 = Panel(item_2.Item1)  # disabled
panel_43 = Panel(multiplication_8)  # disabled
pt_7 = ConstructPoint(XCoordinate=deconstruct_4.XComponent, YCoordinate=deconstruct_4.YComponent, ZCoordinate=multiplication_7)  # disabled
pt_8 = ConstructPoint(XCoordinate=deconstruct_4.XComponent, YCoordinate=deconstruct_4.YComponent, ZCoordinate=addition_5)  # disabled
pt_9 = ConstructPoint(XCoordinate=deconstruct_4.XComponent, YCoordinate=deconstruct_4.YComponent, ZCoordinate=multiplication_8)  # disabled
pt_10 = ConstructPoint(XCoordinate=deconstruct_4.XComponent, YCoordinate=deconstruct_4.YComponent, ZCoordinate=addition_4)  # disabled
polyline_4 = PolyLine(Vertices=pt_8, Closed=False)  # disabled
ln_5 = Line(StartPoint=decimal_degrees_to_xy_2.XyPoint, EndPoint=pt_8)  # disabled
ln_6 = Line(StartPoint=decimal_degrees_to_xy_2.XyPoint, EndPoint=pt_7)  # disabled
ln_7 = Line(StartPoint=decimal_degrees_to_xy_2.XyPoint, EndPoint=pt_9)  # disabled
ln_8 = Line(StartPoint=decimal_degrees_to_xy_2.XyPoint, EndPoint=pt_10)  # disabled
panel_44 = Panel(pt_10)  # disabled
polyline_5 = PolyLine(Vertices=pt_7, Closed=False)  # disabled
polyline_6 = PolyLine(Vertices=pt_10, Closed=False)  # disabled
panel_45 = Panel(item_2.Item7)  # disabled
panel_46 = Panel(pt_7)  # disabled

flatten_3 = FlattenTree(Tree=item_2.Item1, Path="{0}")  # disabled
flatten_4 = FlattenTree(Tree=item_2.Item, Path="{0}")  # disabled
geo_3 = Geometry(decimal_degrees_to_xy_2.XyPoint)  # disabled

bake_5 = BakeObjects(Geometry=geo_3, Attributes=ef_att_2.Attributes, Bake=False, createGroups=False)  # -> Message, Ghosts; disabled
